# Dynamo graph solar analyis_picture combination.dyn (Dynamo 2.3.0.5885)

# group: file retrieve
# note: input file = solar study PICTURES from revit, or sketchup (best format: png)
directory_path = Directory("\\SERVER01\Users\collaborateur2\Desktop\solar analyis\test sample")  # graph input
directory_from_path = DirectoryObject(path=directory_path)
# note: get all files from folder
getDirectoryContents = FileSystem.GetDirectoryContents(directory=directory_from_path)
file_from_path = FileObject(path=getDirectoryContents.files)
readFromFile = Image.ReadFromFile(file=file_from_path)

# group: rescaling
dimensions = Image.Dimensions(image=readFromFile)
# note: study is very sensitive to image size, by dividing the image size with this integer, we exponentially increase study time
divide_image_by_resolution = IntegerSlider(6, range=1..20 step 1)  # "divide image by (resolution sensitive)"; graph input
code_block = CodeBlock(x=dimensions.width, c=divide_image_by_resolution, y=dimensions.height) { x/c; y/c; }
ceiling = Math.Ceiling(number=code_block.out0)
ceiling_2 = Math.Ceiling(number=code_block.out1)
pixels = Image.Pixels(image=readFromFile, xSamples=ceiling, ySamples=ceiling_2)

# group: rescale_test
integer_slider = IntegerSlider(1, range=1..20 step 1)
getItemAtIndex = List.GetItemAtIndex(list=pixels, index=integer_slider)
fromPixels = Image.FromPixels(colors=getItemAtIndex)
watch_image = WatchImageCore(image=fromPixels)

# group: test run
code_block_2 = CodeBlock()
# ---------- code_block_2.designscript (11 lines) ----------
[0,
0.1,
0,
0,
1,
0.7,
0.4,
1,
0.9,
0.5,
0];
# ----------------------------------------
code_block_3 = CodeBlock { [0,0,0,0,0.5,0.5,0.5,1,1,0.5,0]; }
# note: test sample for algorithm, each list represents brightness levels of one image
code_block_4 = CodeBlock { [0,0,0,0,1,0.5,0.5,1,1,0.5,0]; }
# note: most computational intesive node, retrieve data from EACH pixel
list_create = List.Create(item0=code_block_2, item1=code_block_3, item2=code_block_4)

# group: black of first picture
# note: group still not used, function for a later update:
# extracting black points of first image to add them above the compilation
firstItem = List.FirstItem()  # unwired: list
code_block_5 = CodeBlock { 1; 0.2; }
replaceByCondition = Replace(item=firstItem, replaceWith=code_block_5.out0)  # unwired: condition

# group: output folder
# note: directory created image
output_folder = Directory("\\SERVER01\Users\collaborateur2\Desktop")
name_analysis = StringInput("analysis_1.png")
combinePath = FileSystem.CombinePath(path0=output_folder, path1=name_analysis)

flatten = List.Flatten(list=pixels)
# note: flatten each image for computation
code_block_6 = CodeBlock(x=ceiling, y=ceiling_2) { x*y; }
chop = List.Chop(list=flatten, lengths=code_block_6)

# group: white and black
brightness = Color.Brightness(c=chop)
# note: by setting the brightness (0 to 1) to the power of two, I bring gray values (0.5) closer to black (0).
# The rouding divide the pixels in white OR black
code_block_7 = CodeBlock { 2; }
pow = Math.Pow(number=brightness, power=code_block_7)
round = Math.Round(number=pow)

code_block_8 = CodeBlock(x=round) { 1-x; }
# note: the interval of pictures in one hour
# 1 each hour = 1
# 2 each hour (every 30 min) = 2
time_interval = IntegerSlider(1, range=1..3 step 1)  # graph input

# group: sum/ time scale
transpose = List.Transpose(lists=code_block_8)
sum = Math.Sum(values=transpose)
divide_by_time_interval_of_study = sum / time_interval

# group: color assignment
# note: color range colors, from white to yellow to red to blue and dark blue
code_block_9 = CodeBlock()
# ---------- code_block_9.designscript (11 lines) ----------
[255,255,255];
[255,255,50];
[255,180,20];
[255,110,0];
[255,0,0];
[255,10,116];
[255,0,180];
[0,180,180];
[3,100,187];
[39,2,156];
[1,12,110];
# ----------------------------------------
list_create_2 = List.Create(item0=code_block_9.out0, item1=code_block_9.out1, item2=code_block_9.out2, item3=code_block_9.out3, item4=code_block_9.out4, item5=code_block_9.out5, item6=code_block_9.out6, item7=code_block_9.out7, item8=code_block_9.out8, item9=code_block_9.out9, item10=code_block_9.out10)
reverse = List.Reverse(list=list_create_2)
transpose_2 = List.Transpose(lists=list_create_2)
deconstruct = List.Deconstruct(list=transpose_2)
deconstruct_2 = List.Deconstruct(list=deconstruct.rest)
byARGB = Color.ByARGB(r=deconstruct.first, g=deconstruct_2.first, b=deconstruct_2.rest@L2)
flatten_2 = List.Flatten(list=byARGB)
code_block_10 = CodeBlock { 0..1..0.1; }
# note: each color represents a color fase of 10 hours, the image of the legend is in the dynamo folder
code_block_11 = CodeBlock(x=divide_by_time_interval_of_study) { x/10; }
# note: evaluate brightness to assign color
color_range = ColorRange(colors=flatten_2, indices=code_block_10, value=code_block_11)

code_block_12 = CodeBlock(x=ceiling, y=ceiling_2) { x; y; }
code_block_13 = CodeBlock(x=code_block_12.x, y=code_block_12.y) { x; y; }
firstItem_2 = List.FirstItem(list=code_block_13.x)
firstItem_3 = List.FirstItem(list=code_block_13.y)
fromPixels_2 = Image.FromPixels(colors=color_range, width=firstItem_2, height=firstItem_3)
# note: compilate image
watch_image_2 = WatchImageCore(image=fromPixels_2)

# group: write image
writeToFile = Image.WriteToFile(path=combinePath, image=watch_image_2)
