# Dynamo graph solar analyis_start solar study.dyn (Dynamo 2.3.0.5885)

# group: maybe needed
startDateTime = SunSettings.StartDateTime()  # unwired: sunSettings
endDateTime = SunSettings.EndDateTime()  # unwired: sunSettings
horizontalFrameAtParameter = Curve.HorizontalFrameAtParameter()  # unwired: curve

# group: export image
views = Views("{3D}")
code_block = CodeBlock { 1000; }
pause = Thread.Pause(x=views, msTimeout=code_block)
directory_path = Directory("\\SERVER01\Users\collaborateur2\Desktop")
exportAsImage = View.ExportAsImage(view=pause, path=directory_path)
watch_image = WatchImageCore(image=exportAsImage)

# group: Set hour and date
start_hour = IntegerSlider(20, range=6..20 step 1)
end_hour = IntegerSlider(11, range=6..20 step 1)
code_block_2 = CodeBlock { 2021; }
code_block_3 = CodeBlock { 03; }
code_block_4 = CodeBlock { 15; }
byDateAndTime = DateTime.ByDateAndTime(year=code_block_2, month=code_block_3, day=code_block_4, hour=end_hour)

# group: set solar type date and interval
precision_divide_each_hour_by = IntegerSlider(2, range=1..4 step 1)
code_block_5 = CodeBlock(a=precision_divide_each_hour_by) { 1/a; }
# note: test frame number
frame = CodeBlock { 7; }
code_block_6 = CodeBlock { 1..4..1; }
reverse = List.Reverse(list=code_block_6)
string_from_object = FromObject(obj=reverse)
code_block_7 = CodeBlock { ["Minutes15","Minutes20","Minutes30","Minutes60"]; }
# note: transform precision into solar study parameter
byKeysValues = DesignScript.Builtin.Dictionary.ByKeysValues(keys=string_from_object, values=code_block_7)
string_from_object_2 = FromObject(obj=precision_divide_each_hour_by)
valueAtKey = DesignScript.Builtin.Dictionary.ValueAtKey(dictionary=byKeysValues, key=string_from_object_2)
python_script = Python(IN[0]=frame, IN[1]=valueAtKey, IN[2]=byDateAndTime)
# ---------- python_script.python (39 lines) ----------
import clr

clr.AddReference('RevitServices')
from RevitServices.Persistence import DocumentManager
from RevitServices.Transactions import TransactionManager
clr.AddReference('RevitAPI')
from Autodesk.Revit.DB import *
clr.AddReference('System')
import System

# The following is our first line of code which gets active revit
# document into a variable called doc
doc = DocumentManager.Instance.CurrentDBDocument
# inputs from Dynamo to the Python node are saved in a list called IN[ ]
# IN[0] is the first input value IN[1] would be the next…etc
# a day from sunrise to sunset is divided into frames or time intervals
frame = IN[0]
interv = IN[1]
slide_DT = IN[2]

# The following line gets the sunSettings from the Revit model’s current view
sunSettings = doc.ActiveView.SunAndShadowSettings

DT_kind = System.DateTimeKind.Local
slide_DT = System.DateTime.SpecifyKind(slide_DT, DT_kind)
# we are going to change the model so we begin a transaction in the doc (document)
TransactionManager.Instance.EnsureInTransaction(doc)
# we set for a one day study, time intervals at 30 minutes, and set the active frame
# active frame is the input coming from the Number Slider
sunSettings.SunAndShadowType = SunAndShadowType.OneDayStudy
sunSettings.TimeInterval = SunStudyTimeInterval.Minutes30
sunSettings.ActiveFrame = frame
sunSettings.StartDateAndTime = slide_DT
# all changes done so close the transaction
TransactionManager.Instance.TransactionTaskDone()
# no output required
# when you drag the Number Slider the sun location will move back and forth in
# intervals of 30 minutes.
OUT = interv
# ----------------------------------------

# group (continued): Set hour and date
code_block_8 = CodeBlock(s=start_hour, e=end_hour, i=code_block_5) { s..e..i; }
# note: analysed hours
# calculated whith how many frames per hour
watch = Watch(code_block_8)
